# Grasshopper definition gd_screengrab.gh (Grasshopper 1.0.7)
# plug-ins: Human

number_slider = Slider(29, range=0..29)
w = Slider(900, range=300..1000)
h = Slider(450, range=300..1000)

# ----
# Create local directory for imgs
panel = Panel("sshots")
python = GhPythonScript()  # -> out, fd
# ---------- python: Python ----------
__author__ = "Lorenzo"
__version__ = "2019.04.05"

import rhinoscriptsyntax as rs
import os

# get file path of current gh file
fp = ghenv.LocalScope.ghdoc.Path
print("current gh file path: {}".format(fp))

# get file directory and file name
(fd, fn) = os.path.split(fp)
print("file directory: {}".format(fd))
print("file name: {}".format(fn))
print("----")
# ---------- end python ----------
python_2 = GhPythonScript(output_dir_name=panel, model_dir=python.fd, active=Toggle(False))  # -> out, out_dir
# ---------- python_2: Python ----------
__author__ = "Lorenzo"
__version__ = "2019.03.23"

import rhinoscriptsyntax as rs
import os

if active:
    out_dir = os.path.join(model_dir, output_dir_name)
    
    if not os.path.exists(out_dir):
        os.makedirs(out_dir)
# ---------- end python_2 ----------
panel_2 = Panel(python_2.out_dir)

panel_3 = Panel("""A
Shop""")
# Load geo to stylize
panel_4 = Panel("Program")

# ---- group: IMPORT BLOCKS
python_3 = GhPythonScript()  # -> out, a, b, c; disabled
# ---------- python_3: Python ----------
__author__ = "Lorenzo"
__version__ = "2019.02.25"

import rhinoscriptsyntax as rs
import Rhino
import scriptcontext as sc
from pprint import pprint

sc.doc = Rhino.RhinoDoc.ActiveDoc
#sc.doc = ghdoc

block_names = rs.BlockNames()
#pprint(block_names)

rooms = []

for block_name in block_names:
#    print(block_name)
    instances = rs.BlockInstances(block_name)
    xforms = [rs.BlockInstanceXform(i) for i in instances]
    
    geo = rs.BlockObjects(block_name)
#    print(geo)
    room_blocks = []
    
    for g in geo:
        if rs.IsPolysurface(g):
            room_blocks.append(g)
    
    for x in xforms:
        rooms.extend(rs.TransformObjects(room_blocks, x, copy=True))
        

a = rooms

sc.doc = ghdoc
# ---------- end python_3 ----------
python_4 = GhPythonScript(active=Toggle(False))  # -> out, a
# ---------- python_4: Python ----------
__author__ = "Lorenzo"
__version__ = "2019.02.25"

import rhinoscriptsyntax as rs
import scriptcontext as sc
import Rhino

if active:
    sc.doc = Rhino.RhinoDoc.ActiveDoc
    
    
    b_dupl_geo = []
    layers = ["Paint",
        "Step A",
        "Step B",
        "Step C",
        "Step D",
        "DPP",
        "Step 0",
        "Step 1",
        "Step 2",
        "Step 3+4"]
    for ln  in layers:
    #    b.extend(rs.ObjectsByLayer(ln))
        lay_geos = rs.ObjectsByLayer(ln)
        for i, geo in enumerate(lay_geos):
            if rs.IsPolysurface(geo):
                b_dupl_geo.append(geo)
                
    rs.DeleteObjects(b_dupl_geo)
# ---------- end python_4 ----------

# ----
crv = Curve()
number_slider_2 = Slider(0.5, range=0..1)
python_5 = GhPythonScript()  # -> out, a; disabled
# ---------- python_5: Python ----------
__author__ = "Lorenzo"
__version__ = "2019.04.05"

import rhinoscriptsyntax as rs

fn = '10.png'

print(fn[-3])
# ---------- end python_5 ----------

# ---- group: w
data = Data(w)

# ---- group: h
data_2 = Data(h)

# ----
python_6 = GhPythonScript()  # -> out, fd; disabled; same code as python
panel_5 = Panel("screengrabzz")  # disabled
multiplication = Multiplication(A=data, B=number_slider_2)
multiplication_2 = Multiplication(A=data_2, B=number_slider_2)
python_7 = GhPythonScript(output_dir_name=panel_5, model_dir=python_6.fd)  # -> out, out_dir; disabled
# ---------- python_7: Python ----------
__author__ = "Lorenzo"
__version__ = "2019.03.23"

import rhinoscriptsyntax as rs
import os

out_dir = os.path.join(model_dir, output_dir_name)

if not os.path.exists(out_dir):
    os.makedirs(out_dir)
# ---------- end python_7 ----------
panel_6 = Panel(python_7.out_dir)  # disabled
# Stylize
pipeline = GeometryPipeline(
    GroupByLayer=False,
    GroupByType=False,
    IncludeHidden=True,
    IncludeLocked=True,
    LayerFilter="SITE LINES",
    NameFilter="*",
    SublayerFiltering=True,
    TypeFilter=4)
toggle = BooleanToggle(False)  # disabled
toggle_2 = BooleanToggle(False)  # disabled
button = Button()  # disabled
button_2 = Button()  # disabled
dom = ConstructDomain(DomainStart=expr("-x/2", multiplication), DomainEnd=expr("x/2", multiplication))
dom_2 = ConstructDomain(DomainStart=expr("-x/2", multiplication_2), DomainEnd=expr("x/2", multiplication_2))
md_slider = MDSlider(
    SliderMode=0,
    slider_value=Point(0.9887017971, 0.09988254454, 0.5),
    x_domain=Domain(0, 1),
    y_domain=Domain(0, 1),
    z_domain=Domain(0, 1))
previewlw = CustomPreviewLineweights(
    Geometry=pipeline,
    Shader=ColourSwatch(SwatchColor=RGB(153, 153, 153)),
    Thickness=Slider(1.5, range=0..4),
    Absolute=False)
number_slider_3 = Slider(3, range=0..10)
panel_7 = Panel("""Flexibility
Embodied Energy
Daylight
Public Visibility
Inter-Disciplinary Exposure
Existing Character
Adjacency
Buzz
Lindsey""")
data_3 = Data(number_slider)

# ---- group: names
data_4 = Data(panel_7)

# ----
seed = Data(data_3)
lng = ListLength(List=data_4)

# ---- group: radius
data_5 = Data(Slider(45, range=0.1..60))

# ---- group: num_goals
data_6 = Data(lng)

# ----
random = Random(Range=Domain(0, 1), Number=lng, Seed=seed)
panel_8 = Panel(random)

# ----
# Set camera view
zoom = Slider(0.7, range=0..2)
# Load camera reference curve
panel_9 = Panel("iso view - UK")

X = UnitX(Factor=Slider(56, range=-80..80))
Y = UnitY(Factor=Slider(-63, range=-80..80))
panel_10 = Panel(panel_9)  # disabled

python_8 = GhPythonScript(n=number_slider)  # -> padded_num; inputs n: Int32
# ---------- python_8: Python ----------
__author__ = "Lorenzo"
__version__ = "2019.04.05"

import rhinoscriptsyntax as rs

padded_num = '{0:02d}'.format(n)
# ---------- end python_8 ----------
panel_11 = Panel(python_8)
concat = Concatenate(FragmentA=python_8, FragmentB="::", FragmentC="AREA_CRV")
dpipeline = DynamicGeometryPipeline(
    LayerFilter="AREA_CRV",
    TypeFilter="All",
    NameFilter="*",
    GroupByLayer=False,
    GroupByType=False,
    IncludeHidden=True,
    IncludeLocked=True,
    enableFullPath=True,
    listenToAttriubtes=True)

concat_2 = Concatenate(FragmentA="Features", FragmentB="::", FragmentC="Lines")
concat_3 = Concatenate(FragmentA=panel_4, FragmentB="::", FragmentC=panel_3)
concat_4 = Concatenate(FragmentA=python_8, FragmentB="::", FragmentC=concat_2)
concat_5 = Concatenate(FragmentA=python_8, FragmentB="::", FragmentC=concat_3)
item = ListItem(List=dpipeline, Index=number_slider, Wrap=True)
dpipeline_2 = DynamicGeometryPipeline(
    LayerFilter=concat_4,
    TypeFilter="All",
    NameFilter="*",
    GroupByLayer=False,
    GroupByType=False,
    IncludeHidden=True,
    IncludeLocked=True,
    enableFullPath=True,
    listenToAttriubtes=True)
dpipeline_3 = DynamicGeometryPipeline(
    LayerFilter=concat_5,
    TypeFilter="All",
    NameFilter="*",
    GroupByLayer=False,
    GroupByType=False,
    IncludeHidden=True,
    IncludeLocked=True,
    enableFullPath=True,
    listenToAttriubtes=True)
geo = Geometry(dpipeline_2)
geo_2 = Geometry(dpipeline_3)
move = Move(Geometry=item, Motion=X)  # -> Geometry, Transform
move_2 = Move(Geometry=move.Geometry, Motion=Y)  # -> Geometry, Transform

area = Area(Geometry=move_2.Geometry)  # -> Area, Centroid
scale = Scale(Geometry=move_2.Geometry, Center=area.Centroid, Factor=zoom)  # -> Geometry, Transform

# ---- group: area
crv_2 = Curve(scale.Geometry)

# ----
crv_3 = Curve(crv_2)
explode = Explode(Curve=crv_3, Recursive=True)  # -> Segments, flatten(Vertices)

python_9 = GhPythonScript(active_restore_view=Toggle(True), active_zoom_bbox=Toggle(True), bbox_pts=explode.Vertices, vp_name=panel_9, w=w, h=h)  # -> out, cam_plane; inputs bbox_pts: list of Point3d
# ---------- python_9: Python ----------
__author__ = "Lorenzo"
__version__ = "2019.03.26"

import rhinoscriptsyntax as rs
import Rhino
import scriptcontext as sc
import System.Drawing
sc.doc = Rhino.RhinoDoc.ActiveDoc

def zoom_bbox(pts, vpName, width, height):
    pts = rs.coerce3dpointlist(pts)
    if pts:
        bbox = Rhino.Geometry.BoundingBox(pts)
        RhinoDocument = Rhino.RhinoDoc.ActiveDoc
        view = RhinoDocument.Views.Find(vpName, False)
        view.Floating = True
        view.Size = System.Drawing.Size(width, height)
        vp = view.ActiveViewport
        vp.ZoomBoundingBox(bbox)
        print('zoom extent on curve boundingbox')
    else:
        print('no pts geo provided for zoom bbox')   

def set_view(vpName):
    rs.RestoreNamedView(vpName)
    print("{} view restored".format(vpName))

if vp_name:
    if active_restore_view:
        set_view(vp_name)
        rs.ShowWorldAxes(view=vp_name, show=False)
else:
    print("no view name provided")

if bbox_pts:
    if active_zoom_bbox:
        zoom_bbox(bbox_pts, vp_name, w, h)
else:
    print("no pts provided")        
    

def get_cam_plane(vpName):
    
    view_cam = rs.CurrentView(vpName)
    
    if view_cam:
        cam_plane = rs.ViewCameraPlane(view_cam)
        return cam_plane

cam_plane = get_cam_plane(vp_name)
# ---------- end python_9 ----------
panel_12 = Panel(python_9.out)

geo_3 = Geometry(geo_2)
pln = Plane(python_9.cam_plane)

# ---- group: lines
crv_4 = Curve(geo)

# ----
debrep = DeconstructBrep(Brep=geo_3)  # -> Faces, Edges, Vertices
rectangle = Rectangle(Plane=pln, XSize=dom, YSize=dom_2, Radius=0)  # -> Rectangle, Length
join = JoinCurves(Curves=flatten(debrep.Edges), Preserve=False)
dash = DashPattern(Curve=crv_4, Pattern=[Slider(4, range=0..4), Slider(1.5, range=0..4)])  # -> Dashes, Gaps
evalsrf = EvaluateSurface(Surface=reparameterize(rectangle.Rectangle), Point=md_slider)  # -> Point, Normal, UDirection, VDirection, Frame
len = Length(Curve=join)
previewlw_2 = CustomPreviewLineweights(Geometry=join, Shader=ColourSwatch(SwatchColor=RGB(0, 0, 0)), Thickness=Slider(2.5, range=0..4), Absolute=False)
previewlw_3 = CustomPreviewLineweights(Geometry=dash.Dashes, Shader=ColourSwatch(SwatchColor=RGB(0, 0, 0)), Thickness=Slider(2.8, range=0..4), Absolute=False)
ma = MassAddition(Input=len)  # -> Result, PartialResults
data_7 = Data(ma.Result)  # disabled
python_10 = GhPythonScript(
    create_dir=button,
    clear_imgs_dir=button_2,
    active=toggle,
    r5=toggle_2,
    dir=python_7.out_dir,
    img_name=data_7,
    vp_name=panel_10)  # -> out, active_out; disabled
# ---------- python_10: Python ----------
__author__ = "Lorenzo"
__version__ = "2019.03.23"

import rhinoscriptsyntax as rs
import Rhino
import System.Drawing
import os
import scriptcontext as sc
import shutil
import time

#imgs_dir = os.path.join(dir, 'imgs')
imgs_dir = dir
if create_dir:
    if not os.path.exists(imgs_dir):
        os.makedirs(imgs_dir)

def remove_folder_contents(dir):
    for the_file in os.listdir(dir):
        file_path = os.path.join(dir, the_file)
        try:
            if os.path.isfile(file_path):
                os.unlink(file_path)
        except Exception as e:
			print("error: {}".format(e))

if clear_imgs_dir:
    remove_folder_contents(imgs_dir)

#vp_name = "000"
w_px = 1400
h_px = 800
scale_f = 1
fext = '.png'

def check_and_fix_for_duplicates(file_path):
    duplicate = True
    counter = 1
    while duplicate:
        duplicate = os.path.exists(file_path)
        if not duplicate:
            break
        if duplicate:
            fn = file_path.split("\\")[-1]
            path_elements = file_path.split("\\")[:-1]
            print(path_elements)
            fn_chars = [c for c in fn]
            if "_" in fn_chars:
                print(fn[-8])
                new_fn = fn[:-8] + "_" + "{:03d}".format(counter) + ".png"
                counter += 1
                path_elements.append(new_fn)
                file_path = "\\".join(path_elements)
    
            else:
                new_fn = fn[:2] + "_" + "{:03d}".format(counter) + ".png"
                counter += 1
                path_elements.append(new_fn)
                file_path = "\\".join(path_elements)
            
            print(fn)
            
    return file_path           

if img_name == None:
    img_name = "give_me_a_name"
fn = str(img_name) + fext
fp = os.path.join(imgs_dir, fn)
#if os.path.exists(fp): 
#    fn = str(img_name) + "_02" + fext
#    fp = os.path.join(imgs_dir, fn)
fp = check_and_fix_for_duplicates(fp)


def vcap_to_file(viewportName='Top', width=w_px, height=h_px, scale_factor=1, file_path=''):
    RhinoDocument = Rhino.RhinoDoc.ActiveDoc
    view = RhinoDocument.Views.Find(viewportName, False)

    # view settings
    if view:
        
        view.Floating = True
        view.Size = System.Drawing.Size(width, height)
        
        view_capture = Rhino.Display.ViewCapture()
#        print(view_capture)
        view_capture.Width = view.ActiveViewport.Size.Width * scale_factor
        view_capture.Height = view.ActiveViewport.Size.Height * scale_factor
        view_capture.ScaleScreenItems = False
        view_capture.DrawAxes = False
        view_capture.DrawGrid = False
        view_capture.DrawGridAxes = False
        view_capture.TransparentBackground = False
        bitmap = view_capture.CaptureToBitmap(view)
        
        if bitmap:
            bitmap.Save(file_path, System.Drawing.Imaging.ImageFormat.Png)
            print("saved {}".format(fp))

def vcap_to_file_r5(viewportName='Top', width=w_px, height=h_px, scale_factor=1, file_path=''):
    view_capture_cmd = "_-ViewCaptureToFile \"" +  \
            file_path + \
            "\" Width " + str(width*scale_factor) + \
            " Height " + str(height*scale_factor) + \
            " Enter "
    rs.Command(view_capture_cmd)
    print("saved (r5) {}".format(fp))



if active:
#    time.sleep(1)
    
    if r5:
        vcap_to_file_r5(viewportName = vp_name, 
                        width = w_px,
                        height = h_px,
                        scale_factor = scale_f,
                        file_path = fp)
        
    else:                   
        vcap_to_file(viewportName = vp_name, 
                    width = w_px,
                    height = h_px,
                    scale_factor = scale_f,
                    file_path = fp)
    if img_name:
        active_out = True
else:
    print("not active")
    active_out = False
# ---------- end python_10 ----------
panel_13 = Panel(python_10.out)  # disabled
pt = Point(evalsrf.Point)
pl_origin = PlaneOrigin(Base=pln, Origin=pt)
dashboard_plane = Plane(pl_origin)
cluster = Cluster(num_goals=data_6, base_plane=dashboard_plane, radius=data_5, subd_num=Slider(4, range=1..10), scores_0_to_1=random)  # -> goal_crvs_2, outer_crv_3, intermediate_crvs_2, score_crv_2, goal_arrows
crv_5 = Curve(cluster.outer_crv_3)
crv_6 = Curve(cluster.goal_crvs_2)
crv_7 = Curve(cluster.intermediate_crvs_2)
crv_8 = Curve(cluster.score_crv_2)
geo_4 = Geometry(cluster.goal_arrows)
crv_9 = Curve(crv_6)
crv_10 = Curve(crv_5)
crv_11 = Curve(crv_7)
dash_2 = DashPattern(Curve=crv_9, Pattern=[Slider(1, range=0..4), Slider(1.1, range=0..4)])  # -> Dashes, Gaps
preview = CustomPreview(Geometry=geo_4, Material=ColourSwatch(SwatchColor=RGB(0, 0, 0)))
previewlw_4 = CustomPreviewLineweights(Geometry=dash_2.Dashes, Shader=ColourSwatch(SwatchColor=RGB(0, 0, 0)), Thickness=Slider(1, range=0..10))
previewlw_5 = CustomPreviewLineweights(Geometry=crv_11, Shader=ColourSwatch(SwatchColor=RGB(105, 105, 105)), Thickness=Slider(1, range=0..10))
previewlw_6 = CustomPreviewLineweights(Geometry=crv_10, Shader=ColourSwatch(SwatchColor=RGB(0, 0, 0)), Thickness=Slider(2, range=0..10))
cluster_2 = Cluster_2(A_2=Slider(1.7, range=0.1..5), A=Slider(6.1, range=1..12), crv=crv_6, pln=dashboard_plane, data=data_4)

# ---- group: performance
swatch = ColourSwatch(SwatchColor=RGB(0, 0, 0))
swatch_2 = ColourSwatch(SwatchColor=RGB(107, 165, 201))
crv_12 = Curve(crv_8)
previewlw_7 = CustomPreviewLineweights(Geometry=crv_12, Shader=ColourSwatch(SwatchColor=RGB(0, 158, 237)), Thickness=Slider(10, range=0..10))
deplane = DeconstructPlane(Plane=dashboard_plane)  # -> Origin, XAxis, YAxis, ZAxis
amp = Amplitude(Vector=deplane.ZAxis, Amplitude="-1")
move_3 = Move(Geometry=crv_12, Motion=amp)  # -> Geometry, Transform

# ----
srf = Surface(move_3.Geometry)

# ---- group: performance (continued)
geo_5 = Geometry(srf)
preview_2 = CustomPreview(Geometry=geo_5, Shader=swatch_2)

# ----
panel_14 = Panel(swatch_2)

# ==== cluster Cluster
subd_num = ClusterInput()
radius = ClusterInput()
subd_num_2 = Data(subd_num)
base_plane = ClusterInput()

# ---- group: length
radius_2 = Data(radius)

# ----
base_plane_2 = Plane(base_plane)
deplane = DeconstructPlane(Plane=base_plane_2)  # -> Origin, XAxis, YAxis, ZAxis
num_goals = ClusterInput()
scores_0_to_1 = ClusterInput()
num_goals_2 = Data(num_goals)
line = LineSDL(Start=base_plane_2, Direction=deplane.YAxis, Length=radius_2)
division = Division(A="360", B=num_goals_2)
scores_0_to_1_2 = Data(scores_0_to_1)
random = Random(Range=Domain(0, 1), Number=7, Seed=2)
series = Series(Start=0, Step=division, Count=num_goals_2)
rotate = Rotate(Geometry=line, Angle=degrees(series), Plane=base_plane_2)  # -> Geometry, Transform
end = EndPoints(Curve=rotate.Geometry)  # -> Start, End
divide = DivideCurve(Curve=rotate.Geometry, Count=subd_num_2, Kinks=False)  # -> Points, Tangents, Parameters
eval = EvaluateCurve(Curve=rotate.Geometry, Parameter=scores_0_to_1_2)  # -> Point, Tangent, Angle
flip = FlipMatrix(Data=divide.Points)
pline = PolyLine(Vertices=end.End, Closed=True)
pline_2 = PolyLine(Vertices=flip, Closed=True)
pline_3 = PolyLine(Vertices=eval.Point, Closed=True)
outer_crv = Curve(pline)
outer_crv_2 = Curve(pline)
intermediate_crvs = Curve(pline_2)
goal_crvs = Curve(rotate.Geometry)
score_crv = Curve(pline_3)
intermediate_crvs_2 = ClusterOutput(intermediate_crvs)
goal_crvs_2 = ClusterOutput(goal_crvs)
outer_crv_3 = ClusterOutput(outer_crv)
score_crv_2 = ClusterOutput(score_crv)

# ---- group: dashb_bo
crv = Curve(outer_crv_2)

# ----
divide_2 = DivideCurve(Curve=reparameterize(crv), Count=num_goals_2, Kinks=False)  # -> Points, Tangents, Parameters
number_slider = Slider(0.021, range=0..0.25)
neg = Negative(Value=number_slider)
addition = Addition(A=divide_2.Parameters, B=neg)
addition_2 = Addition(A=divide_2.Parameters, B=number_slider)
entwine = Entwine(Branch00=addition_2, Branch01=addition, FlattenInputs=True)
flip_2 = FlipMatrix(Data=entwine)
python = PythonScript(x=flip_2)  # -> out, x; inputs x: list
# ---------- python: Python ----------
for ix, item in enumerate(x):
    if item < 0:
        x[ix] = 1 - abs(item)
# ---------- end python ----------
eval_2 = EvaluateCurve(Curve=reparameterize(crv), Parameter=python.x)  # -> Point, Tangent, Angle
pline_4 = PolyLine(Vertices=eval_2.Point, Closed=False)  # -> simplify(Polyline)
ln = Line(StartPoint=eval_2.Point, EndPoint=graft(divide_2.Points))  # -> simplify(Line)
join = JoinCurves(Curves=[ln, pline_4], Preserve=False)
boundary = BoundarySurfaces(Edges=join)
goal_arrows = ClusterOutput(boundary)

# ==== cluster Cluster_2
pln = ClusterInput()
crv = ClusterInput()
A = ClusterInput()
pln_2 = Plane(pln)
crv_2 = Curve(crv)
end = EndPoints(Curve=crv_2)  # -> Start, End
data = ClusterInput()
amp = Amplitude(Vector=crv_2, Amplitude=A)
fonts = FontTable()
panel = Panel(fonts)
panel_2 = Panel("Roboto Black")
pt = Point(end.End)

# ---- group: goal_names
data_2 = Data(data)

# ----
deplane = DeconstructPlane(Plane=pln_2)  # -> Origin, XAxis, YAxis, ZAxis
A_2 = ClusterInput()
move = Move(Geometry=pt, Motion=amp)  # -> Geometry, Transform
python = GhPythonScript(txt_locs=pt)  # -> out, hor_alignment_vals, ver_alignment_vals; inputs txt_locs: list
# ---------- python: Python ----------
__author__ = "Lorenzo"
__version__ = "2019.04.05"

import rhinoscriptsyntax as rs


hor_alignment_vals = []
ver_alignment_vals = []
for i in range(len(txt_locs)):

    if i > 0 and i < len(txt_locs)/2:
        hor_alignment_vals.append(2)

    elif i > len(txt_locs)/2 and i < len(txt_locs):
        hor_alignment_vals.append(0)
        
    else:
        hor_alignment_vals.append(1)
 
 
    if i == len(txt_locs)/4 or i ==len(txt_locs)*(3/4):
        ver_alignment_vals.append(1)
    
    elif i > len(txt_locs)/4 and i < len(txt_locs)*(3/4):
        ver_alignment_vals.append(0)
        
    else:
        ver_alignment_vals.append(2)
# ---------- end python ----------
amp_2 = Amplitude(Vector=deplane.YAxis, Amplitude=A_2)
python_2 = GhPythonScript(font_table=fonts, font="Roboto")  # -> out, font_out; inputs font_table: list
# ---------- python_2: Python ----------
__author__ = "Lorenzo"
__version__ = "2019.03.25"

import rhinoscriptsyntax as rs

if font in font_table:
    font_out = font
    
else:
    print("didn't find font. Setting to default")
    font_out = "Arial"
# ---------- end python_2 ----------
panel_3 = Panel(python_2.font_out)
multiplication = Multiplication(A=amp_2, B=-1)
move_2 = Move(Geometry=move.Geometry, Motion=multiplication)  # -> Geometry, Transform
pl_origin = PlaneOrigin(Base=pln_2, Origin=move_2.Geometry)
points = PointList(Points=move.Geometry, Size=2)
justified_text = JustifiedText3d(
    Location=pl_origin,
    Text=data_2,
    Size=Slider(4, range=1..5),
    Color=ColourSwatch(SwatchColor=RGB(0, 0, 0)),
    HorizontalAlignment=python.hor_alignment_vals,
    VerticalAlginment=Slider(2, range=0..2),
    Font=python_2.font_out,
    UseMeshes=False,
    Bake=False)
